# Dynamo graph Floor.dyn "floor_finish_24_script" (Dynamo 2.17.0.3472)
# packages: Data-Shapes 2024.2.113, Orchid 220.0.1.7329, archi-lab.net 2024.217.1024

categories = Categories("OST_Rooms")
all_elements_of_category = ElementsOfCategory(Category=categories)
code_block = CodeBlock { "Floor Finish"; }
getParameterValueByName = Element.GetParameterValueByName(element=all_elements_of_category, parameterName=code_block)
code_block_2 = CodeBlock { "Z"; }
contains = String.Contains(string=getParameterValueByName, searchFor=code_block_2)
code_block_3 = CodeBlock { "Level"; }
getParameterValueByName_2 = Element.GetParameterValueByName(element=all_elements_of_category, parameterName=code_block_3)
code_block_4 = CodeBlock { "Instructions"; }
string = StringInput("""Kat bazlı çalışıyor. Type mark parametresi Z içeren floor tiplerini(zemin kaplamaları) alarak tiplerin type mark parametresini odaların floor finish parametresi ile eşleyerek hangi odaya hangi kaplamayı atacağını buluyor.
Odaların floor finish parametresi(room style schedule) ve kaplama tiplerinin type mark parametreleri çalıştırmadan kontrol edilmeli.
Merdiven kaplaması floor olmadığı için merdiven kaplaması içeren odaların floor inish parametresi input olarak istenmektedir.""")
textnote_data = Custom[TextNote Data](Title=code_block_4, TextNote=string)  # package Data-Shapes; Create Data for TextNote input in UI.MultipleInputForm ++ . Check out www.data-shapes.net for more informations
code_block_5 = CodeBlock { "Room Level"; }
categories_2 = Categories("OST_Levels")
all_elements_of_category_2 = ElementsOfCategory(Category=categories_2)
name = Element.Name(element=all_elements_of_category_2)
code_block_6 = CodeBlock(x=all_elements_of_category_2) { (DSCore.List.Count(x)-2); }
dropdown_data = Custom[DropDown Data](InputName=code_block_5, Keys=name, Values=all_elements_of_category_2, DefaultValueIndex=code_block_6)  # package Data-Shapes; Create data for DropDown input in UI.MultiInputForm ++ . Check out www.data-shapes.net for more infos.
code_block_7 = CodeBlock { "Floor Finish Level"; }
categories_3 = Categories("OST_Levels")
all_elements_of_category_3 = ElementsOfCategory(Category=categories_3)
name_2 = Element.Name(element=all_elements_of_category_3)
code_block_8 = CodeBlock(x=all_elements_of_category_3) { (DSCore.List.Count(x)-2); }
dropdown_data_2 = Custom[DropDown Data](InputName=code_block_7, Keys=name_2, Values=all_elements_of_category_3, DefaultValueIndex=code_block_8)
code_block_9 = CodeBlock { "FFL-SSL Distance"; }
string_2 = StringInput("100")
textbox_data = Custom[TextBox Data](InputName=code_block_9, DefaultText=string_2)  # package Data-Shapes; Create Data for TextBox input in UI.MultipleInputForm ++ . Check out www.data-shapes.net for more informations
list_create = List.Create(item0=textnote_data, item1=dropdown_data, item2=dropdown_data_2, item3=textbox_data)

# group: FORM
code_block_10 = CodeBlock { "Apply"; }
boolean = BoolSelector(true)
code_block_11 = CodeBlock { "Cancel"; }
code_block_12 = CodeBlock { 450; 220; 600; }
multipleinputform = Custom[MultipleInputForm ++](ButtonText_optional=code_block_10, Inputs=list_create, Toggle=boolean, CancelButtonText_optional=code_block_11, MaxHeight_optional=code_block_12.out2, Width_optional=code_block_12.out0)  # package Data-Shapes; Create a form with multiple inputs. see www.data-shapes.net for tutorials and infos!

code_block_13 = CodeBlock(IN=multipleinputform.User_Inputs) { IN[0]; IN[1]; IN[2]; }
name_3 = Element.Name(element=code_block_13.out0)
eq = getParameterValueByName_2 == name_3
and_ = contains && eq
filterByBoolMask = List.FilterByBoolMask(list=all_elements_of_category, mask=and_)
watch = Watch(filterByBoolMask.in)
finishBoundary = Room.FinishBoundary(room=watch)
count = List.Count(list=finishBoundary@L3)
code_block_14 = CodeBlock { 0; }
allIndicesOf = List.AllIndicesOf(list=count, item=code_block_14)
removeItemAtIndex = List.RemoveItemAtIndex(list=watch, indices=allIndicesOf)
finishBoundary_2 = Room.FinishBoundary(room=removeItemAtIndex)
byJoinedCurves = PolyCurve.ByJoinedCurves(curves=finishBoundary_2)
isEmpty = List.IsEmpty(list=byJoinedCurves@L2)
filterByBoolMask_2 = List.FilterByBoolMask(list=removeItemAtIndex, mask=isEmpty)

# group: Yapamadı!!!
watch_2 = Watch(filterByBoolMask_2.in)

# group: Yapamadı!!!
getItemAtIndex = List.GetItemAtIndex(list=watch, index=allIndicesOf)

modelleme_koşulları = CodeBlock()
# ---------- modelleme_koşulları.designscript (18 lines) ----------
/*
**Level bazlı çalışıyor. Type mark parametresi Z içeren floor tiplerini(zemin
kaplamaları) alarak tiplerin type mark parametresini odaların floor finish
parametresi ile eşleyerek hangi odaya hangi kaplamayı atacağını buluyor.
Odaların floor finish parametresi(room style schedule) ve kaplama tiplerinin type
mark parametreleri çalıştırmadan kontrol edilmeli.
Merdiven kaplaması floor olmadığı için merdiven kaplaması içeren odaların floor
finish parametresi input olarak istenmektedir.



**4 farklı input istenmektedir.
	1. Odaların level'ı.
	2. Merdiven kaplaması istenen odanın floor finish parametresi.
	3. Kaplamaların atılacağı level.
	4. FFL ve SSL arasındaki kot farkı.

*/;
# ----------------------------------------
modelleme_metodolojisi = CodeBlock()
# ---------- modelleme_metodolojisi.designscript (13 lines) ----------
/*
Genel bir pratik olarak aşağıdaki sıralamayla gidilmesi düşünülmüştür:

1. Gerekli floor tiplerinin projede olup olmadığı ve type mark parametreleri
   kontrol edilecek.

2. Room style schedule kontrol edilecek.

3. Gerekli inputlar girilecek.

4. Son adım olarak dynamo script'i kod açılarak veya dynamo player vasıtasıyla
   run edilecek.
*/;
# ----------------------------------------

# group: Kalan Odalar
watch_3 = Watch(filterByBoolMask_2.out)

# group: Kalan Odalar
watch_4 = Watch(watch_3)
code_block_15 = CodeBlock { "Floor Finish"; }

getParameterValueByName_3 = Element.GetParameterValueByName(element=watch_4, parameterName=code_block_15)
code_block_16 = CodeBlock { "+"; }
split = String.Split(string=getParameterValueByName_3, separator0=code_block_16)
firstItem = List.FirstItem(list=split@L2)
element_types = ElementTypes("FloorType")
all_elements_of_type = ElementsOfType(element_type=element_types)
code_block_17 = CodeBlock { "Type Mark"; }
getParameterValueByName_4 = Element.GetParameterValueByName(element=all_elements_of_type, parameterName=code_block_17)
code_block_18 = CodeBlock { "Z"; }
contains_2 = String.Contains(string=getParameterValueByName_4, searchFor=code_block_18)
filterByBoolMask_3 = List.FilterByBoolMask(list=all_elements_of_type, mask=contains_2)

# group: Type mark Z içeren floorlar
watch_5 = Watch(filterByBoolMask_3.in)

code_block_19 = CodeBlock { "Type Mark"; }
getParameterValueByName_5 = Element.GetParameterValueByName(element=watch_5, parameterName=code_block_19)
eq_2 = firstItem == getParameterValueByName_5  # lacing=CrossProduct
code_block_20 = CodeBlock { true; }
indexOf = List.IndexOf(list=eq_2@L2, element=code_block_20)
code_block_21 = CodeBlock { 0; }
ge = indexOf >= code_block_21
code_block_22 = CodeBlock { false; }
indexOf_2 = Orchid.Core.List.IndexOf(list=ge, element=code_block_22)
getItemAtIndex_2 = List.GetItemAtIndex(list=getParameterValueByName_3, index=indexOf_2)
code_block_23 = CodeBlock { 0; }
code_block_24 = CodeBlock { "--"; }
insert = String.Insert(string=getItemAtIndex_2, index=code_block_23, toInsert=code_block_24)
getItemAtIndex_3 = List.GetItemAtIndex(list=watch_4, index=indexOf_2)
name_4 = Room.Name(room=getItemAtIndex_3)
insert_2 = String.Insert(string=insert, index=code_block_23, toInsert=name_4)
code_block_25 = CodeBlock { "İ"; "I"; }
replace = String.Replace(string=insert_2, searchFor=code_block_25.out0, replaceWith=code_block_25.out1)
python_script = Python(IN[0]=replace)  # IronPython2
# ---------- python_script.python (30 lines) ----------
import clr
clr.AddReference('RevitAPI')
clr.AddReference('RevitAPIUI')

from System.Reflection import BindingFlags
from Autodesk.Revit.UI import TaskDialog, TaskDialogCommonButtons
from System import Array, Object

# Listeyi IN[0]'dan al
result_list = IN[0]

# Listeyi düzgün bir string'e çevir ve her öğeyi yeni satıra yazdır
result_text = "\n".join([str(item) for item in result_list])

# Uyarı penceresini oluştur
main_dialog = TaskDialog("Warning")  # Başlık
main_dialog.TitleAutoPrefix = False
main_dialog.Title = "Floor Finish"  # Pencere başlığı
main_dialog.MainInstruction = "Wall type not found. Type Mark parameter must be created correctly."  # Ana talimat
main_dialog.MainContent = result_text  # MainContent kısmına liste öğelerini alt alta yazdır
main_dialog.FooterText = "Prota Engineering"
main_dialog.CommonButtons = TaskDialogCommonButtons.Ok | TaskDialogCommonButtons.Cancel

# Argümanlar için boş bir Object dizisi oluştur
arguments = Array[Object]([])

# Diyaloğu göster ve sonucu al
result = clr.GetClrType(main_dialog.GetType()).InvokeMember("Show", BindingFlags.InvokeMethod, None, main_dialog, arguments)

OUT = result
# ----------------------------------------
filterByBoolMask_4 = List.FilterByBoolMask(list=watch_4, mask=ge)
finishBoundary_3 = Room.FinishBoundary(room=filterByBoolMask_4.in)
endPoint = Curve.EndPoint(curve=finishBoundary_3)
code_block_26 = CodeBlock { 1; }
shiftIndices = List.ShiftIndices(list=endPoint@L2, amount=code_block_26)
byStartPointEndPoint = Line.ByStartPointEndPoint(startPoint=endPoint@L2, endPoint=shiftIndices@L2)
byJoinedCurves_2 = PolyCurve.ByJoinedCurves(curves=byStartPointEndPoint)
count_2 = List.Count(list=finishBoundary_3@L3)
chop = List.Chop(list=byJoinedCurves_2, lengths=count_2)

# group: Floor Dış Sınırları
firstItem_2 = List.FirstItem(list=chop@L2)

filterByBoolMask_5 = List.FilterByBoolMask(list=indexOf, mask=ge)

# group: Mahaller ile eşleşen floor tipleri
getItemAtIndex_4 = List.GetItemAtIndex(list=watch_5, index=filterByBoolMask_5.in)

byOutlineTypeAndLevel = Floor.ByOutlineTypeAndLevel(outline=firstItem_2, floorType=getItemAtIndex_4, level=code_block_13.out1)
code_block_27 = CodeBlock { "Height Offset From Level"; }
code_block_28 = CodeBlock { "Default Thickness"; }
getParameterValueByName_6 = Element.GetParameterValueByName(element=getItemAtIndex_4, parameterName=code_block_28)
code_block_29 = CodeBlock(TEST=code_block_13.out2) { TEST; }
toNumber = String.ToNumber(string=code_block_29)
sub = getParameterValueByName_6 - toNumber
setParameterByName = Element.SetParameterByName(element=byOutlineTypeAndLevel, parameterName=code_block_27, value=sub)
count_3 = List.Count(list=setParameterByName)
python_script_2 = Python(IN[0]=count_3)  # IronPython2
# ---------- python_script_2.python (29 lines) ----------
import clr
clr.AddReference('RevitAPI')
clr.AddReference('RevitAPIUI')

from System.Reflection import BindingFlags
from Autodesk.Revit.UI import TaskDialog, TaskDialogCommonButtons
from System import Array, Object

# Listeyi IN[0]'dan al
result_list = str(IN[0])

# Listeyi düzgün bir string'e çevir ve her öğeyi yeni satıra yazdır

# Uyarı penceresini oluştur
main_dialog = TaskDialog("Warning")  # Başlık
main_dialog.TitleAutoPrefix = False
main_dialog.Title = "Floor Finish"  # Pencere başlığı
main_dialog.MainInstruction = "Result"
main_dialog.MainContent = result_list +" " +"Floor finish is correctly positioned"
main_dialog.FooterText = "Prota Engineering"
main_dialog.CommonButtons = TaskDialogCommonButtons.Ok | TaskDialogCommonButtons.Cancel

# Argümanlar için boş bir Object dizisi oluştur
arguments = Array[Object]([])

# Diyaloğu göster ve sonucu al
result = clr.GetClrType(main_dialog.GetType()).InvokeMember("Show", BindingFlags.InvokeMethod, None, main_dialog, arguments)

OUT = result
# ----------------------------------------
name_5 = archilab.Revit.Elements.Room.Name(room=watch_4)
name_6 = Room.Name(room=watch_4)
